% Simulink data dictionary AEB_Data.sldd

Gravity = Simulink.Parameter(9.81, DataType="half", Unit="m/s^2")
L_Limit = Simulink.Parameter(-1.1, DataType="half")
Min_Dis_Stop_Veh = Simulink.Parameter(2, DataType="uint8", Unit="m")
R_Limit = Simulink.Parameter(1.1, DataType="half")
Out_Rang = Simulink.Parameter(300, DataType="uint16")
On_Value = Simulink.Parameter(1, DataType="uint8")
Obstacle_Longitudinal_Distance = Simulink.Parameter([], DataType="half", Min=0, Max=260, Unit="m")
Obstacle_Lateral_Distance = Simulink.Parameter([], DataType="half", Unit="m")
Reac_Time = Simulink.Parameter(1, DataType="uint8", Unit="Sec")
Friction = Simulink.Parameter(0.7, DataType="half", Min=0, Max=1, Unit="newton")
AEB_Warning = Simulink.Parameter(1)
No_Warning = Simulink.Parameter(0)
AEB_Brake_Apply = Simulink.Parameter(1)
Growth_Time_Dec = Simulink.Parameter(0.1, DataType="half")
Host_Vehicle_Velocity = Simulink.Parameter([], DataType="half", Min=0, Max=240, Unit="kmph")
Obstacle_Velocity = Simulink.Parameter([], DataType="half", Min=0, Max=240, Unit="kmph")
Driving_Mode_Active = Simulink.Parameter(1, DataType="boolean")
Reverse_Mode_Active = Simulink.Parameter(0, DataType="boolean")
Radar_Det_Range_Lower_Tshld = Simulink.Parameter(2, DataType="uint8", Unit="meter")
Radar_Det_Range_Upper_Tshld = Simulink.Parameter(250, DataType="uint8", Unit="meter")
CAN_Bus_Load_Range = Simulink.Parameter(70, DataType="uint8", Unit="%")
Radar_Det_Speed_Range_Lower_Tshld = Simulink.Parameter(1, DataType="uint8", Unit="km/hr")
Radar_Det_Speed_Range_Upper_Tshld = Simulink.Parameter(300, DataType="uint16", Unit="km/hr")
Radar_Temp_Lower_Tshld = Simulink.Parameter(-40, DataType="int8", Unit="°C")
Radar_Temp_Upper_Tshld = Simulink.Parameter(85, DataType="uint8", Unit="°C")
Lidar_Det_Range_Lower_Tshld = Simulink.Parameter(1, DataType="uint8", Unit="meter")
Lidar_Det_Range_Upper_Tshld = Simulink.Parameter(200, DataType="uint8", Unit="meter")
Camera_Range_Lower_Tshld = Simulink.Parameter(1, DataType="uint8", Unit="meter")
Camera_Range_Upper_Tshld = Simulink.Parameter(150, DataType="uint8", Unit="meter")
Lidar_Det_Speed_Range_Lower_Tshld = Simulink.Parameter(1, DataType="uint8", Unit="km/hr")
Lidar_Det_Speed_Range_Upper_Tshld = Simulink.Parameter(200, DataType="uint8", Unit="km/hr")
Lidar_Temp_Lower_Tshld = Simulink.Parameter(-20, DataType="int8", Unit="°C")
LIdar_Temp_Upper_Tshld = Simulink.Parameter(60, DataType="uint8", Unit="°C")
ECU_Temprature_Lower_Tshld = Simulink.Parameter(-40, DataType="int8", Unit="°C")
ECU_Temprature_Upper_Tshld = Simulink.Parameter(85, DataType="uint8", Unit="°C")
ECU_Process_Response_Time_Tshld = Simulink.Parameter(100, DataType="uint8", Unit="ms")
ECU_Voltage_Lower_Tshld = Simulink.Parameter(10, DataType="uint8", Unit="V")
ECU_Voltage_Upper_Tshld = Simulink.Parameter(18, DataType="uint8", Unit="V")
Brake_Actuator_Resp_Time_Tshld = Simulink.Parameter(150, DataType="uint8", Unit="ms")
Brake_Actuator_Hyd_Press_Lower_Tshld = Simulink.Parameter(290, DataType="uint16", Unit="psi")
Brake_Actuator_Hyd_Press_Upper_Tshld = Simulink.Parameter(2175, DataType="uint16", Unit="psi")
Brake_Actuator_Temp_Lower_Tshld = Simulink.Parameter(20, DataType="uint8", Unit="°C")
Brake_Actuator_Temp_Upper_Tshld = Simulink.Parameter(100, DataType="uint8", Unit="°C")
Brake_Actuator_Fluid_Level_Tshld = Simulink.Parameter(50, DataType="uint8", Unit="%")